% Simulink data dictionary CE.sldd

A = Simulink.Signal(StorageClass="ExportedGlobal", DataType="unit8", InitialValue="0")  % Global variable
B = Simulink.Signal(StorageClass="ExportedGlobal", DataType="uint8", InitialValue="0")  % Global variable

CamLaneInfo = Simulink.Bus()
  LH_Line_First_C0: single
  LH_Line_First_C1: single
  LH_Line_First_C2: single
  LH_Line_First_C3: double
  LH_First_VR_Start: single
  LH_First_VR_End: single
  LH_Line_First_Age: uint8
  LH_Line_First_Confidence: single
  LH_Line_First_Color: uint8
  LH_Line_First_Lanemark_Type_1: uint8
  LH_Line_Second_C0: single
  LH_Line_Second_C1: single
  LH_Line_Second_C2: single
  LH_Line_Second_C3: double
  LH_Second_VR_Start: single
  LH_Second_VR_End: single
  LH__Line_Second_Age_: uint8
  LH__Line_Second_Confidence: single
  LH__Line_Second_Color: uint8
  LH__Line_Second_Lanemark_Type: uint8
  LH__Line_Second_DLM_Type: uint8
  LA_Line_Second_C0: single
  LA_Line_Second_C1: single
  LA_Line_Second_C2: single
  LA_Line_Second_C3: double
  LA_Second_VR_Start: single
  LA_Second_VR_End: single
  LA_Line_Second_Age: uint8
  LA_Line_Second_Confidence: single
  LA_Line_Second_Color: uint8
  LA_Line_Second_Lanemark_Type: uint8
  LA_Line_First_C0: single
  LA_Line_First_C1: single
  LA_Line_First_C2: single
  LA_Line_First_C3: double
  LA_First_VR_Start: single
  LA_First_VR_End: single
  LA_Line_First_Age: uint8
  LA_Line_First_Confidence: single
  LA_Line_First_Color: uint8
  LA_Line_First_Lanemark_Type: uint8

EgoVehicleInfo = Simulink.Bus()
  LogitudelOveride: uint8
  LatralOveride: uint8
  VelocityHMI: single
  SetDictence: single
  LDrvnWhlRotlDircnHSC2: uint8
  VehSpdAvgNonDrvnHSC2: single
  VSELongtAccHSC2: single
  VSELatAccHSC2: single
  VehDynYawRateHSC2: single
  VehSpdAvgHSC2: single
  StrgWhlAngVHSC2: single
  StrgWhlAngHSC2: single
  BrkPdlDrvrAppdPrs_RadarHSC2: single
  WhlBrkPrsStsHSC2: uint8
  RDrvnWhlRotlDircnHSC2: uint8
  ChACCAccReqRespHSC2: uint8
  BrkPdlAppdHSC2: single
  EPBAppcnStsHSC2: uint8
  PtACCToqReqRespHSC2: uint8
  EPTAccelActuPosHSC2: single
  DircnIndLampSwStsHSC2: uint8
  RDircnIOHSC2: uint8
  LDircnIOHSC2: uint8
  FrtFogLghtOnHSC2: uint8
  FrtWiperSwStsHSC2: uint8
  trgWhlAngGrdHSC2: single
  RNonDrvnWhlRotlDircnHSC2: uint8
  LNonDrvnWhlRotlDircnHSC2: uint8
  DrvrStrgDlvrdToqHSC2: single
  ChLKARespToqHSC2: single
  TrShftLvrPos_h1HSC2: uint8
  EPTAccelEfctvPosHSC2: single

Frinfo = Simulink.Bus()
  RadarAccObjLateralDistance: single
  RadarAccobjLogitudelDistance: single
  RadarAccobjLateralVelocity: single
  RadarAccobLogitudelVelocity: single
  cutinObjID: uint8

FunctionState = Simulink.Bus()
  NOPStateFlag: uint8
  LKAStateflag: uint8
  ACCStateFlag: uint8
  ILCStateFlag: uint8
  LanechangeStateFlag: uint8

FunctionSwitch = Simulink.Bus()
  TJAorICA_Switch: uint8
  ICA_Switch: uint8
  NOP_Switch: uint8

Gain = Simulink.Parameter(3, StorageClass="ExportedGlobal", DataType="unit8")

MapSpecilSitInfo = Simulink.Bus()
  TunnelLength: single
  TunnelLogitudeDictance: single
  ConesLogitudeDistance: single
  ConesLatralDistance: single

NaviInfo = Simulink.Bus()
  LaneChangeNumRequest: uint8
  LocationLaneNum: uint8
  Distance2latestPointNOP: single

SDFinfo = Simulink.Bus()
  SFDobjLateralDistance: single
  SFDobjLogitudelDistance: single
  SFDobjLateralVelocity: single
  SFDobjLogitudelVelocity: single
  SFDobjType: uint8
  SFDobjLength: single
  SFDobjWidth: single
  SFDobjHeight: single

X = Simulink.Signal(StorageClass="ExportedGlobal", DataType="uint8", InitialValue="0")  % Global variable

MapLaneInfo = Simulink.Bus()
  HDM_Line_First_C0: single
  HDM_Line_First_C1: single
  HDM_Line_First_C2: single
  HDM_Line_First_C3: double
  HDM_First_VR_Start: single
  HDM_First_VR_End: single
  HDM_Line_First_Age: uint8
  HDM_Line_First_Confidence: single
  HDM_Line_First_Color: uint8
  HDM_Line_First_Lanemark_Type_1: uint8

gCE_in = Simulink.Bus()
  CamLaneInfo: Bus: CamLaneInfo
  FunctionSwitch: Bus: FunctionSwitch
  SDFinfo: Bus: SDFinfo[50]
  Frinfo: Bus: Frinfo[4]
  FunctionState: Bus: FunctionState
  MapLaneInfo: Bus: MapLaneInfo[6]
  MapSpecilSitInfo: Bus: MapSpecilSitInfo
  NaviInfo: Bus: NaviInfo
  EgoVehicleInfo: Bus: EgoVehicleInfo